# Grasshopper definition GH01_GeomConversionTesting.gh (Grasshopper 1.0.6)
# plug-ins: UserDataUtils

cud = CreateCustomUserData(A="asdf")
ellipse = Ellipse(
    Plane=Plane(origin=(-263, -4, 0), x=(0.6401843997, 0.7682212796, 0), y=(0.7682212796, -0.6401843997, 0)),
    Radius1=3,
    Radius2=1)  # -> Ellipse, Focus1, Focus2
sud = SetUserData(Object=ellipse.Ellipse, UserData=cud)

# ---- group: Select something in rhino and click this dude
rsel = RhSelection(x=Toggle(True))  # -> out, A, B
# ---------- rsel: C# usings ----------
using System.IO;
using System.Linq;
using System.Data;
using System.Drawing;
using System.Reflection;
using System.Windows.Forms;
using System.Xml;
using System.Xml.Linq;
using System.Runtime.InteropServices;

using Rhino.DocObjects;
using Rhino.Collections;
using GH_IO;
using GH_IO.Serialization;
# ---------- rsel: C# ----------
    A = RhinoDoc.ActiveDoc.Objects.GetSelectedObjects(true, true).Select(xxx => xxx.Geometry);

    B = RhinoDoc.ActiveDoc.Objects.GetSelectedObjects(true, true).Select(xxx => xxx.Geometry.GetType());
# ---------- end rsel ----------

# ----
panel = Panel(rsel.B)
series = Series(Start=0, Step=3, Count=10)
srl = Serialiser(Object=rsel.A)  # -> ConversionResultString, ConversionResult
dsr = Deserialiser(Object=srl.ConversionResult)
Z = UnitZ(Factor=series)
lng = ListLength(List=Z)
geo = Geometry(dsr)
srl_2 = Serialiser(Object=geo)  # -> ConversionResultString, ConversionResult
c_script = CSharpScript(x=srl_2.ConversionResult, y=srl.ConversionResult)  # -> out, A, B
# ---------- c_script: C# ----------
    if(x == null || y == null) return;
    
    var hash1 = x.GetType().GetProperty("Hash").GetValue(x, null) as string;
    var hash2 = y.GetType().GetProperty("Hash").GetValue(y, null) as string;

    A = hash1 == hash2;
    B = hash1 + " vs " + hash2;
# ---------- end c_script ----------
range = Range(Domain=Domain(0, 6.28), Steps=expr("x-1", lng))
panel_2 = Panel(srl.ConversionResultString)
xy = XYPlane(Origin=Z)

# ---- group: Theoretically, hashes should be the same after a serialisation run
are_the_hashes_equal = Panel(c_script.A)
panel_3 = Panel(c_script.B)

# ----
rotate = Rotate(Geometry=xy, Angle=range, Plane=PlaneXY(0, 0, 0))  # -> Geometry, Transform
cir = Circle(Plane=rotate.Geometry, Radius=3)
srl_3 = Serialiser(Object=cir)  # -> ConversionResultString, ConversionResult
anonymous_stream = DataSender(B=cir, remotecontroller=False)  # -> Log, StreamId
dsr_2 = Deserialiser(Object=srl_3.ConversionResult)
anonymous_stream_2 = DataReceiver(ID=anonymous_stream.StreamId)  # -> F1aac9adE7c44cb9A0808d8fbcf3551a, E8d1dc288a02426482a319647d71cbf5, Aa6d8e5a2292423aAa392d253a57baa5
geo_2 = Geometry(dsr_2)
eval = EvaluateCurve(Curve=geo_2, Parameter=0)  # -> Point, Tangent, Angle
eval_2 = EvaluateCurve(Curve=cir, Parameter=0)  # -> Point, Tangent, Angle
eval_3 = EvaluateCurve(Curve=anonymous_stream_2.E8d1dc288a02426482a319647d71cbf5, Parameter=0)  # -> Point, Tangent, Angle
panel_4 = Panel(srl_2.ConversionResultString)
